% Requirement links of CruiseControl_Destiny.slx (R2018b)

model implements CruiseControl.slreqx#1: Interface
model implements CruiseControl.slreqx#10: Functional
model implements CruiseControl.slreqx#25: Safety
block :26 implements CruiseControl.slreqx#2: Enable/Disable Switch
block :27 implements CruiseControl.slreqx#6: Vehicle Brake Input
block :28 implements CruiseControl.slreqx#3: Set Speed/Decelerate Button
block :29 implements CruiseControl.slreqx#5: Vehicle Speed Input
block :30 implements CruiseControl.slreqx#4: Resume Speed/Accelerate Button
block :46 implements CruiseControl.slreqx#9: Target Speed Output
block :47 implements CruiseControl.slreqx#8: Engaged (active) Output
block :56 implements CruiseControl.slreqx#35: Cancel Switch
block :7:105 implements CruiseControl.slreqx#17: Initial transition from disengaged (inactive) to engaged (active) only with “Set Speed” input after enabling (on)
block :7:105 implements CruiseControl.slreqx#18: “Resume” input ignored until the initial transition from disengaged (inactive) to engaged (active)
block :7:105 implements CruiseControl.slreqx#20: Subsequent transition from disengaged (inactive) to engaged (active) with “Resume” input while enabled (on)
block :7:107 implements CruiseControl.slreqx#17: Initial transition from disengaged (inactive) to engaged (active) only with “Set Speed” input after enabling (on)
block :7:107 implements CruiseControl.slreqx#19: Subsequent transition from disengaged (inactive) to engaged (active) with “Set Speed” input while enabled (on)
block :7:47 implements CruiseControl.slreqx#14: Disabled (off) during start-up
block :7:50 implements CruiseControl.slreqx#16: Disengaged (not active) when disabled (off)
block :7:52 implements CruiseControl.slreqx#15: Not engaged with enabling (on)
block :7:55 implements CruiseControl.slreqx#26: Vehicle braking will transition system to disengaged (inactive) when engaged (active)
block :7:55 implements CruiseControl.slreqx#27: Transition to engaged (active) will only be permitted for vehicle speeds between 20 and 90 mph
block :7:55 implements CruiseControl.slreqx#28: Transition to disengaged (inactive) when vehicle speed is outside the limits of 20 to 90 mph
block :7:55 implements CruiseControl.slreqx#34: Cancel will return speed control to driver
block :7:56 implements CruiseControl.slreqx#21: “Accelerate” input increases target speed only when engaged (active)
block :7:65 implements CruiseControl.slreqx#21: “Accelerate” input increases target speed only when engaged (active)
block :7:65 implements CruiseControl.slreqx#29: Target speed will be limited between 20 and 90 mph
block :7:66 implements CruiseControl.slreqx#29: Target speed will be limited between 20 and 90 mph
block :7:67 implements CruiseControl.slreqx#29: Target speed will be limited between 20 and 90 mph
block :7:73 implements CruiseControl.slreqx#22: “Decelerate” input decreases target speed only when engaged (active)
block :7:74 implements CruiseControl.slreqx#22: “Decelerate” input decreases target speed only when engaged (active)
block :7:74 implements CruiseControl.slreqx#29: Target speed will be limited between 20 and 90 mph